vi "Main.gviweb"   [LabVIEW NXG 2.0.0]
panel controls:
  "Run": bool
  "Selected VI": enum{"Mandelbrot"} = "Mandelbrot"
panel indicators:
  "printLog": string
  "printErrorLog": string
uses:
  Application::VireoApi::GetViaFile.gviweb
  Application::VireoApi::Create.gviweb
  Application::VireoApi::Run.gviweb
  Application::VireoApi::State.gviweb
diagram:
  while {
    case ($Run) {
      frame False, Default { }
      frame True {
        call "GetViaFile.gviweb"(Selected VI=$"Selected VI") -> (viaCode=w1, error out=w2)
        call "Create.gviweb"(viaCode=w1, error in=w2) -> (instanceId out=w3, error out=w4)
        call "Run.gviweb"(instanceId in=w3, error in=w4) -> (instanceId out=w5, error out=w6)
        s1 = w6  # shift register
        while {
          call "State.gviweb"(instanceId in=w5, error in=s1) -> (instanceId out=w7, running?=w8, printLog=w9, printErrorLog=w10, error out=w11)
          $printLog <- w9
          $printErrorLog <- w10
          Wait(time to wait=100)
          next s1 = w11
          stop if w8
        }
        call "State.gviweb"(instanceId in=w7, error in=s1) -> (printLog=w12, printErrorLog=w13)
        $printLog <- w12
        $printErrorLog <- w13
      }
    }
    Wait(time to wait=50)
    stop if FALSE
  }
