vi "Create.gviweb"   [LabVIEW NXG 2.0.0]
inputs:
  "viaCode": string
  "error in": error
outputs:
  "instanceId out": string
  "error out": error
uses:
  NI::HTTP::Open HTTP Handle.gvi
  NI::HTTP::Add Header.gvi
  NI::HTTP::POST Buffer.gvi
  NI::HTTP::Close HTTP Handle.gvi
diagram:
  Property Node(instance in=cluster{"viaCode": string} {all zero or empty}, "viaCode"=$viaCode) -> (instance out=w1)
  Flatten To JSON(anything=w1, error in (no error)=$"error in") -> (JSON string=w2, error out=w3)
  call "Open HTTP Handle.gvi"(error in=w3) -> (client handle out=w4, error out=w5)
  call "Add Header.gvi"(header="Content-Type", client handle=w4, value="application/json", error in=w5) -> (client handle out=w6, error out=w7)
  call "POST Buffer.gvi"(client handle=w6, url="/vireos", buffer=w2, error in=w7) -> (client handle out=w8, body=w9, error out=w10)
  call "Close HTTP Handle.gvi"(client handle=w8, error in=w10) -> (error out=w11)
  Unflatten From JSON(JSON string=w9, error in (no error)=w11, type and defaults=cluster{"instanceId": string} {all zero or empty}) -> (error out=w12, value=w13)
  Property Node(instance in=w13) -> ("instanceId"=w14)
  $"instanceId out" <- w14
  $"error out" <- w12
