vi "GetViaFile.gviweb"   [LabVIEW NXG 2.0.0]
inputs:
  "Selected VI": enum{"Mandelbrot"} = "Mandelbrot"
  "error in": error
outputs:
  "viaCode": string
  "error out": error
uses:
  NI::HTTP::GET.gvi
diagram:
  Format Into String(formatString="ViaTests/%s.via", errIn=$"error in", $"Selected VI") -> (outString=w1, errOut=w2)
  call "GET.gvi"(url=w1, error in=w2) -> (body=w3, error out=w4)
  $viaCode <- w3
  $"error out" <- w4
