vi "Run.gviweb"   [LabVIEW NXG 2.0.0]
inputs:
  "instanceId in": string
  "error in": error
outputs:
  "instanceId out": string
  "error out": error
uses:
  NI::HTTP::POST Buffer.gvi
diagram:
  Format Into String(formatString="/vireos/%s/run", errIn=$"error in", $"instanceId in") -> (outString=w1, errOut=w2)
  call "POST Buffer.gvi"(url=w1, error in=w2) -> (error out=w3)
  $"error out" <- w3
  $"instanceId out" <- $"instanceId in"
