vi "State.gviweb"   [LabVIEW NXG 2.0.0]
inputs:
  "instanceId in": string
  "error in": error
outputs:
  "instanceId out": string
  "running?": bool
  "printLog": string
  "printErrorLog": string
  "error out": error
types:
  T1 = cluster{"state": string, "printLog": string, "printErrorLog": string}
uses:
  NI::HTTP::GET.gvi
diagram:
  Format Into String(formatString="/vireos/%s", errIn=$"error in", $"instanceId in") -> (outString=w1, errOut=w2)
  call "GET.gvi"(url=w1, error in=w2) -> (body=w3, error out=w4)
  Unflatten From JSON(JSON string=w3, error in (no error)=w4, type and defaults=T1 {all zero or empty}) -> (error out=w5, value=w6)
  $"error out" <- w5
  Property Node(instance in=w6) -> ("printLog"=w7, "printErrorLog"=w8, "state"=w9)
  $printLog <- w7
  $"instanceId out" <- $"instanceId in"
  $printErrorLog <- w8
  Is Equal(x=w9, y="RUNNING") -> w10
  $"running?" <- w10
